# Grasshopper definition NestedSphere_v5.gh (Grasshopper 1.0.7)

# Version 5
base_sphere = Slider(5, range=0..100)
offset_distance = Slider(2, range=0..100)
number_slider = Slider(0.1, range=0..0.1)
sphere = Sphere(Base=PlaneXY(0, 0, 0), Radius=base_sphere)
offset_surface = OffsetSurface(Surface=sphere, Distance=offset_distance, Retrim=True)
brep = Brep(offset_surface)
offset_surface_2 = OffsetSurface(Surface=offset_surface, Distance=number_slider, Retrim=True)
offset_surface_3 = OffsetSurface(Surface=offset_surface_2, Distance=offset_distance, Retrim=True)
offset_surface_4 = OffsetSurface(Surface=offset_surface_3, Distance=number_slider, Retrim=True)
offset_surface_5 = OffsetSurface(Surface=offset_surface_4, Distance=offset_distance, Retrim=True)
