# Grasshopper definition four_leaf_clover_clip_v5.gh (Grasshopper 1.0.7)

bottom_clip = Slider(1, range=0..30)
click_wall_thickness = Slider(2, range=0..10)
distance_of_the_bottom_clip = Slider(3, range=0..30)
connector_hight = Slider(-2, range=-6..30)
bottom_clip_length = Slider(12, range=0..30)
bottom_clip_width = Slider(6, range=0..30)
number_slider = Slider(0.9, range=0..1)
addition = Addition(A=click_wall_thickness, B=distance_of_the_bottom_clip)
geometry = Geometry(<curve referenced from the Rhino model>)
unit_z = UnitZ(Factor=distance_of_the_bottom_clip)
unit_z_2 = UnitZ(Factor=addition)
rectangle = Rectangle(Plane=PlaneXY(0, 0, 0), XSize=bottom_clip_width, YSize=connector_hight, Radius=0)  # -> Rectangle, Length
unit_z_3 = UnitZ(Factor=Slider(2, range=0..10))
rectangle_2 = Rectangle(Plane=PlaneXY(0, 0, 0), XSize=bottom_clip_width, YSize=bottom_clip_length, Radius=bottom_clip)  # -> Rectangle, Length
unit_z_4 = UnitZ(Factor=click_wall_thickness)
extrude = Extrude(Base=rectangle.Rectangle, Direction=unit_z_2)
extrude_2 = Extrude(Base=rectangle_2.Rectangle, Direction=unit_z_4)
unit_y = UnitY(Factor=bottom_clip_length)
extrude_3 = Extrude(Base=geometry, Direction=unit_z_3)
cap_holes = CapHoles(Brep=extrude_2)
cap_holes_2 = CapHoles(Brep=extrude_3)
panel = Panel(unit_z_3)
move = Move(Geometry=extrude, Motion=unit_y)  # -> Geometry, Transform
move_2 = Move(Geometry=cap_holes, Motion=unit_z)  # -> Geometry, Transform
cap_holes_3 = CapHoles(Brep=move.Geometry)
brep = Brep(cap_holes)
brep_2 = Brep(move_2.Geometry)
brep_3 = Brep([cap_holes_3, brep, brep_2])
move_3 = Move(Geometry=brep_3, Motion=panel)  # -> Geometry, Transform
brep_4 = Brep(move_3.Geometry)
