# Grasshopper definition Lamp _clip.gh (Grasshopper 1.0.7)

ring_radius = Slider(10, range=0..100)
ring_thickness = Slider(1.2, range=0..10)
rectangle = Rectangle(Plane=PlaneXY(0, 4, 0), XSize=Slider(0.5, range=0..1), YSize=Slider(10, range=0..10), Radius=0)  # -> Rectangle, Length
circle = Circle(Plane=PlaneXY(0, 0, 0), Radius=ring_radius)
unit_z = UnitZ(Factor=Slider(5, range=0..10))
offset_curve = OffsetCurve(Curve=circle, Distance=ring_thickness, Plane=PlaneXY(0, 0, 0), Corners=1)
box_rectangle = BoxRectangle(Rectangle=rectangle.Rectangle, Height=Slider(8, range=0..10))
loft = Loft(
    Curves=flatten([circle, offset_curve]),
    Options={Adjust=False, Closed=False, LoftEnds=0, LoftSimp=0, LoftType=0, Rebuild=10, Refit=0.01})
extrude = Extrude(Base=loft, Direction=unit_z)
